% Simulink data dictionary ArDroneDataDictionary.sldd

IMU_Packets = Simulink.Bus(HeaderFile="IMU_Navdata.h")
  taille: uint16
  nu_trame: uint16
  ax: uint16
  ay: uint16
  az: uint16
  vx: int16
  vy: int16
  vz: int16
  temperature_acc: uint16
  temperature_gyro: uint16
  ultrasound: uint16
  us_debut_echo: uint16
  us_fin_echo: uint16
  us_association_echo: uint16
  us_distance_echo: uint16
  us_curve_time: uint16
  us_curve_value: uint16
  us_curve_ref: uint16
  nb_echo: uint16
  sum_echo: uint32
  gradient: int16
  flag_echo_ini: uint16
  pressure: int32
  temperature_pressure: uint16
  mx: int16
  my: int16
  mz: int16
  chksum: uint16

Measurement_Calculation_Bus = Simulink.Bus()
  UltraSound_Calculation: double  % Calculation of raw ultrasound values. Units in Meters
  AccelNorm_Calculation: double[3]  % Calculation of raw accelerometer values. Units in Gs
  Gyro_Calculation: double[3]  % Calculation of raw gyrometer values. Units in deg/s
  Magnetometer_Calculation: double[3]  % Calculation of raw magnetometer values. Unit-less normalized quantity.

Accel_Calib_Gain = Simulink.Parameter(struct(Gain_X=-0.9877, Gain_Y=-1.0129, Gain_Z=-1.0082), StorageClass="ExportedGlobal", DataType="Bus: Navigation_Gain_Bus")
Accel_Calib_Offset = Simulink.Parameter(struct(Gain_X=-0.0423, Gain_Y=0.0261, Gain_Z=0.0388), StorageClass="ExportedGlobal", DataType="Bus: Navigation_Gain_Bus")
Mag_Calib_Gain_Vector = struct(Gain_X=187, Gain_Y=163, Gain_Z=139)
Mag_Calib_Offset_Vector = struct(Gain_X=-23, Gain_Y=4.3, Gain_Z=1.44)

Navigation_Gain_Bus = Simulink.Bus()
  Gain_X: double
  Gain_Y: double
  Gain_Z: double

AR_Drone_ConfigSet_NOEXT = Simulink.ConfigSet(StartTime="0", StopTime="20", FixedStep="1/400", Solver="FixedStepDiscrete", ProdHWDeviceType="ARM Compatible->ARM Cortex", SystemTargetFile="ert.tlc", TargetLang="C")  % This configuration set can be used to generate code that runs on the Parrot AR Drone 2.0 in Normal mode.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
ColorTrackingParameters = [1280; 720; 5; 0; 122; 0; 122; 10]
AR_Drone_ConfigSet = Simulink.ConfigSet(StartTime="0", StopTime="inf", FixedStep="1/400", Solver="FixedStepDiscrete", ProdHWDeviceType="ARM Compatible->ARM Cortex", SystemTargetFile="ert.tlc", TargetLang="C")  % This configuration set can be used to generate code that runs on the Parrot AR Drone 2.0 in External mode.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
accelerometerXyzOffsets = [2050.739; 2054.083; 2040.845]
accelerometerXyzGains = [504.2877; 512.9696; 507.6168]
gyroXyzOffsets = [93.01416; 9.678463; 12.39232]
magnetoXyzOffsets = [-99; 41; -95]